# Grasshopper definition main.gh (Grasshopper 1.0.7)
# Copyright: © Timo Harboe ApS

getlib = GhPythonScript()  # -> comp_folder
# ---------- getlib: Python ----------
__author__ = "Serjoscha Duering"
__version__ = "2023.10.12"

import rhinoscriptsyntax as rs
import Grasshopper as gh

components_folder_path = gh.Folders.DefaultAssemblyFolder
comp_folder = str(components_folder_path)
# ---------- end getlib ----------

# ---- group: update nested clusters ( be carefull) / click this first
trigger_a = Button()

# ----
# main definition logic
geometry = Geometry(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)

# ---- group: update nested clusters ( be carefull) / click this second
trigger_b = Button()

# ---- group: click to auto-update all referenced clusters
# auto update (nested) referenced clusters
button = Button()
panel = Panel(getlib)
mx_3 = Slider(3, range=1..3)
update_referenced_clusters = GhPythonScript(trigger=button, searchDepth=mx_3)  # inputs searchDirs: list
# ---------- update_referenced_clusters: Python ----------
__author__ = "Serjoscha Duering"
__version__ = "2023.09.06"


import rhinoscriptsyntax as rs
import Grasshopper as gh
import os
from Grasshopper.Kernel.Special import GH_Cluster

ghenv.Component.Description = """This component updates referenced GH_Clusters in the current document.
If a cluster's original path is unavailable, it searches through provided directories 
to find a matching cluster based on the name. 

Inputs:
- trigger: A boolean toggle to activate the update process.
- searchDirs: (optional) A list of directories to search for .ghcluster files if the original path is unavailable.
- searchDepth: (optional) Depth to search within each directory (e.g., 1 = only the directory, 2 = directory and its immediate sub-directories, etc.).
"""


def find_ghcluster_files_in_directory(directory, depth):
    """
    Recursively find all .ghcluster files in a given directory up to a certain depth.
    Returns a dictionary with the filename (without extension) as key and full path as value.
    """
    ghcluster_files = {}
    for root, dirs, files in os.walk(directory):
        # Check depth
        current_depth = root[len(directory) + len(os.path.sep):].count(os.path.sep)
        if current_depth < depth:
            for file in files:
                if file.endswith(".ghcluster"):
                    file_name_without_extension = os.path.splitext(file)[0]
                    ghcluster_files[file_name_without_extension] = os.path.join(root, file)
    return ghcluster_files

if trigger:
    # Step 1: Index all .ghcluster files in the provided directories
    all_clusters = {}
    for searchDir in searchDirs:
        clusters_in_dir = find_ghcluster_files_in_directory(searchDir, searchDepth)
        all_clusters.update(clusters_in_dir)
    print ( all_clusters.keys())
    # Step 2: Update clusters in the document
    activeDoc = gh.Instances.ActiveCanvas.Document
    mainObjects = activeDoc.Objects
    original_paths_used = True
    try:
        print ("trying")
        gh.Instances.ActiveCanvas.Enabled = False
        
        for obj in mainObjects:
            if isinstance(obj, GH_Cluster):
                try:
                    # First try reading from original location
                    obj.ReadGhClusterFile(obj.FilePath)
                    print str(obj.FilePath)
                except:
                    # If error or not found, attempt to use indexed paths
                    cluster_name = os.path.basename(obj.FilePath)
                    cluster_name_without_extension = os.path.splitext(cluster_name)[0]
                    original_paths_used = False
                    if cluster_name_without_extension in all_clusters:
                        new_path = all_clusters[cluster_name_without_extension]
                        try:
                            obj.ReadGhClusterFile(new_path)
                            print str(new_path)
                        except:
                            pass
    finally:
        if original_paths_used:
            ghenv.Component.Message = "Updated with original paths"
        else:
            ghenv.Component.Message = "Tried original paths and provided directories"
        gh.Instances.ActiveCanvas.Enabled = True
# ---------- end update_referenced_clusters ----------

# ---- group: update nested clusters ( be carefull)
ghpython_script = GhPythonScript(x=trigger_a)  # -> a
# ---------- ghpython_script: Python ----------
__author__ = "Serjoscha Duering"
__version__ = "2023.09.07"

import rhinoscriptsyntax as rs
import scriptcontext as sc

sc.sticky["allowRun"] = True
# ---------- end ghpython_script ----------
iterate_nested_clusters = GhPythonScript(x=trigger_b)  # -> a; inputs x: Boolean
# ---------- iterate_nested_clusters: Python ----------
__author__ = "Serjoscha Duering"
__version__ = "2023.08.28"

import rhinoscriptsyntax as rs
import scriptcontext as sc
import Grasshopper as gh
import time
import Rhino
import System
import Rhino.Geometry as rg
import Grasshopper.DataTree as tree
import Grasshopper.Kernel.Data.GH_Path as ghpath
import copy
from collections import OrderedDict, deque
import clr
import json
from System import Uri
from System.Net import HttpWebRequest, WebHeaderCollection
from System.IO import StreamReader, StreamWriter
from System.Text import Encoding
import datetime



# Function to update docList
def update_doc_list(new_doc):
    sc.sticky["docList"] = [doc for doc in sc.sticky["docList"] if doc['DocumentID'] != str(new_doc.DocumentID)]
    sc.sticky["docList"].insert(0, {'DocumentName': new_doc.DisplayName.replace("*",""), 'DocumentID': str(new_doc.DocumentID)})

# Function to find document index
def find_doc_index(doc_id=None, doc_name=None):
    for i, doc in enumerate(sc.sticky["docList"]):
        if doc_id and doc['DocumentID'] == doc_id:
            return i
        if doc_name and doc['DocumentName'] == doc_name:
            return i
    return None

# Function to close the oldest opened cluster
def close_oldest():
    for doc in sc.sticky["docList"][1:]:
        if doc['DocumentName'] not in [cl['ClusterDocumentName'] for cl in sc.sticky["openedClusters"]]:
            index = find_doc_index(doc_name=doc['DocumentName'])
            if index:
                try:
                    gh.Instances.DocumentServer.RemoveAt(index)
                    break
                except Exception as e:
                    print(str(e))



def process_clusters(objs):
    for obj in objs:
        if isinstance(obj, gh.Kernel.Special.GH_Cluster):
            cluster_id = str(obj.InstanceGuid)
            if cluster_id in sc.sticky["visitedClusters"]:
                continue
            
            # Mark as visited
            sc.sticky["visitedClusters"].add(cluster_id)
            
            # If nearing the maximum number of documents, close the oldest
            if len(sc.sticky["docList"]) >= 31:
                close_oldest()

            # Save basic cluster data
            clusterData = {
                "InstanceGuid": cluster_id,
                "ClusterComponentId": str(obj.ClusterComponentId),
                "Component": obj
            }
            sc.sticky["allClusters"].append(clusterData)

            # Open the cluster document
            obj.EditClusterAsSeparateDocument()
            
            time.sleep(0.05)
            rs.Sleep(5)
            openedClusterDoc = gh.Instances.ActiveCanvas.Document
            update_doc_list(openedClusterDoc)

            # Save opened cluster data
            openedClusterData = {
                "InstanceGuid": cluster_id,
                "ClusterDocumentId": str(openedClusterDoc.DocumentID), 
                "ClusterDocumentName": openedClusterDoc.DisplayName.replace("*", ""),
            }
            sc.sticky["openedClusters"].append(openedClusterData)
            

            
            # Recursive call to process child clusters
            nested_clusters = [o for o in openedClusterDoc.Objects if isinstance(o, gh.Kernel.Special.GH_Cluster)]
            if nested_clusters:
                process_clusters(nested_clusters)
            
            else:
                # Close the cluster if it has no nested clusters 
                index = find_doc_index(doc_id=str(openedClusterDoc.DocumentID))
                if index:
                    gh.Instances.DocumentServer.RemoveAt(index)
                    update_doc_list(openedClusterDoc)
                    
            # ============= actual cluster action ==============================
            # ==================================================================
            if isinstance(obj, gh.Kernel.Special.GH_Cluster):
                #try:
                succes_status = obj.ReadGhClusterFile(obj.FilePath)
                if succes_status == True:
                    # Log success
                    log_entry = {
                        "timestamp": str(datetime.datetime.now()),
                        "cluster_id": cluster_id,
                        "cluster_name":  obj.Name + " - " + obj.NickName,
                        "cluster_filepath": obj.FilePath,
                        "action": "update",
                        "status": "success",
                        "message": "Successfully updated from file."
                    }
                    sc.sticky["log"]["logs"].append(log_entry)
                    sc.sticky["log"]["updated_clusters"] += 1
                else:
                    # Log failure
                    log_entry = {
                        "timestamp": str(datetime.datetime.now()),
                        "cluster_id": cluster_id,
                        "cluster_name": obj.Name + " - " + obj.NickName,
                        "cluster_filepath": obj.FilePath,
                        "action": "update",
                        "status": "failed",
                        "message": "Cluster could not be updated. \n" + str(obj.RuntimeMessages)
                    }
                    sc.sticky["log"]["logs"].append(log_entry)
                    sc.sticky["log"]["not_updatable"].append(cluster_id)
                        
                
                #except Exception as e:
                #    print(str(e))
            
            clusterObj = openedClusterDoc.Objects

            # Return to the parent document
            if sc.sticky["docList"]:
                parent_doc_index = find_doc_index(doc_id=sc.sticky["docList"][1]['DocumentID'])
                if parent_doc_index:
                    gh.Instances.ActiveCanvas.Document = gh.Instances.DocumentServer[parent_doc_index]



# ==============================================================================
# ================================ MAIN  =======================================
# ==============================================================================



if x==True and sc.sticky["allowRun"] == True:
    sc.sticky["log"] = {}
    sc.sticky["log"]["logs"] = []
    sc.sticky["log"]["not_updatable"] = []
    sc.sticky["log"]["updated_clusters"] = 0
    # Initialize sticky variables
    if not "docList" in sc.sticky:
        sc.sticky["docList"] = []
    if not "allClusters" in sc.sticky:
        sc.sticky["allClusters"] = []
    if not "openedClusters" in sc.sticky:
        sc.sticky["openedClusters"] = []
    if not "visitedClusters" in sc.sticky:
        sc.sticky["visitedClusters"] = set()
    sc.sticky["visitedClusters"] = set()
    
    
    # Get the active Grasshopper document
    mainDoc = gh.Instances.ActiveCanvas.Document
    update_doc_list(mainDoc)
    sc.sticky["initialDocument"] = {"DocumentName": mainDoc.DisplayName.replace("*", ""), "DocumentID": str(mainDoc.DocumentID)}
    # Storing initial document's path
    sc.sticky["initialDocumentPath"] = mainDoc.FilePath
   
    if "crossLog" not in sc.sticky:
        sc.sticky["crossLog"] = []
    
    
    
    try:
        # Start processing from the main document
        gh.Instances.ActiveCanvas.Enabled = False
        
        # iterate clusters, cluster clusters  etc.
        process_clusters(mainDoc.Objects)
        
        # go back to initial document
        parent_doc_index = find_doc_index(doc_id=sc.sticky["initialDocument"]['DocumentID'])
        sc.sticky["allowRun"] = False
        
        ghr = Rhino.RhinoApp.GetPlugInObject("Grasshopper")
        ghr.OpenDocument(sc.sticky["initialDocumentPath"])
        gh.Instances.ActiveCanvas.Enabled = True
        
    except Exception as e:
        gh.Instances.ActiveCanvas.Enabled = True
        print("FAIL:", str(e))
# ---------- end iterate_nested_clusters ----------
logs = GhPythonScript(trigger=iterate_nested_clusters)  # -> out, updated, notupdated, logs
# ---------- logs: Python ----------
__author__ = "Serjoscha Duering"
__version__ = "2023.09.14"

import rhinoscriptsyntax as rs
import scriptcontext as sc
import Grasshopper.DataTree as tree
import Grasshopper.Kernel.Data.GH_Path as ghpath

updated = str(sc.sticky["log"]["updated_clusters"])
notupdated =  [str(entry) for entry in sc.sticky["log"]["not_updatable"]]

logs = tree[object]()

for i, entry in  enumerate(sc.sticky["log"]["logs"]):
    entryText = []
    for k, obj in entry.items():
        finString = k + ": \n"
        finString += str(obj)
        entryText.append(finString)
    logs.AddRange(entryText, ghpath(i))
# ---------- end logs ----------

# ---- group: referenced from "VolumeGenerator"
cluster = Cluster_2(linegeo=geometry)

# ---- group: referenced from "utils"
pointcounter = PointCounter_2(list=cluster)

# ----
panel_2 = Panel(logs.updated)
panel_3 = Panel(logs.notupdated)
panel_4 = Panel(logs.logs)

# ==== cluster Cluster_2
linegeo = ClusterInput()
cluster = Cluster(linegeo=linegeo)  # -> points, length
panel = Panel("dummy things")

# ---- group: referenced from "utils"
pointcounter = PointCounter()

# ----
cluster_2 = Cluster(linegeo=cluster.points)  # -> points, length
points = ClusterOutput(cluster.points)

# ==== cluster PointCounter_2
list = ClusterInput()
panel = Panel("/ahahaha")
list_length = ListLength(List=list)
length = ClusterOutput(list_length)

# ==== cluster Cluster
linegeo = ClusterInput()
number_slider = Slider(0, range=0..10)
linegeo_2 = Data(linegeo)
divide_curve = DivideCurve(Curve=linegeo_2, Count=Slider(12, range=0..20), Kinks=False)  # -> Points, Tangents, Parameters
pointcount = PointCount(list=divide_curve.Points)
length = ClusterOutput(pointcount)
points = ClusterOutput(divide_curve.Points)

# ==== cluster PointCounter
list = ClusterInput()
list_length = ListLength(List=list)
panel = Panel("/ahahaha")
length = ClusterOutput(list_length)

# ==== cluster PointCount
list = ClusterInput()
panel = Panel("/ahahaha")
list_length = ListLength(List=list)
length = ClusterOutput(list_length)
